# Grasshopper definition Pyton1.gh (Grasshopper 1.0.7)

trigger = Trigger(Interval=100, TimerInterval=100, Target=python)
python = GhPythonScript(start=Toggle(False))  # -> out, a, b, c; inputs start: Boolean
# ---------- python: Python ----------
from scriptcontext import sticky
import math

if start == True:
    sticky["x"] = 0
    sticky["y"] = 0
    sticky["z"] = 0
else:
    sticky["x"] = sticky["x"] + 0.1
    sticky["y"] = sticky["y"] + 0.1
    sticky["z"] = sticky["z"] + 2

a = 100*math.cos(sticky["x"])
b = 100*math.sin(sticky["y"])
c = sticky["z"]
# ---------- end python ----------
pt = ConstructPoint(XCoordinate=python.a, YCoordinate=python.b, ZCoordinate=python.c)
sph = Sphere(Base=pt, Radius=Slider(10, range=0..10))
rec = DataRecorder(sph, DataLimit=-10, RecordData=True)
